vi "Index.gviweb"   [LabVIEW NXG 5.0.0]
panel controls:
  "Pi (cmH2O)": u32 = 15
  "EDIT MODE": enum{"V A/C", "P A/C", "PSV", "VSIMV", "PSIMV"} = "P A/C"
  "PEEP (cmH2O)": f64 = 5
  "Rate": f64 = 13
  "Start": bool
  "Rise Time": f64 = 2
  "Insp. Time": f64 = 1.5
  "I Sense": f64 = 3
  "Vt Target": f64 = 400
  "PauseAL": bool
  "Freeze Graphs": bool
  "Edit and Apply": bool
  "URL": string = "http://127.0.0.1:8001/WebService1/"
  "Rate_2": f64 = 13
  "PIP (cmH2O)": f64 = 5
  "PIP (cmH2O)_3": f64 = 5
  "PIP (cmH2O)_4": f64
  "PIP (cmH2O)_6": f64 = 5
  "PIP (cmH2O)_7": f64 = 5
  "PIP (cmH2O)_9": f64 = 5
  "PIP (cmH2O)_10": f64 = 5
  "PIP (cmH2O)_12": f64
  "Alarm": bool
  "Waveform": bool
  "Alarm Log": bool
  "Back to Ventilation_3": bool
  "Back to Ventilation_2": bool
  "Apnea Alarm": enum{"YES", "NO"} = "YES"
  "Back to Ventilation_4": bool
  "Back to Alarm": bool
  "Report": bool
  "Pi (cmH2O)_2": f64 = 15
  "EDIT MODE_2": enum{"V A/C", "P A/C", "PSV", "VSIMV", "PSIMV"} = "P A/C"
  "PEEP (cmH2O)_2": f64 = 5
  "Rate_5": f64 = 13
  "Start_2": bool
  "Rise Time_2": f64 = 2
  "Insp. Time_2": f64 = 1.5
  "I Sense_2": f64 = 3
  "Vt Target_2": f64 = 400
  "Change Mode_2": bool
  "Rate_6": f64 = 13
  "Alarm_3": bool
  "Waveform_2": bool
  "Preference_2": bool
  "Setup_2": bool
  "PIP (cmH2O)_13": f64 = 5
  "PIP (cmH2O)_14": f64 = 5
  "PIP (cmH2O)_15": f64 = 5
  "PIP (cmH2O)_16": f64
  "PIP (cmH2O)_17": f64 = 5
  "PIP (cmH2O)_18": f64 = 5
  "PIP (cmH2O)_19": f64 = 5
  "PIP (cmH2O)_20": f64
  "PIP (cmH2O)_21": f64 = 5
  "PIP (cmH2O)_22": f64 = 5
  "PIP (cmH2O)_23": f64 = 5
  "PIP (cmH2O)_24": f64
  "Ventilation_7": bool
  "Alarm Log_2": bool
  "PressureChart_2": f64[]
  "FlowChart_2": f64[]
  "VolumeChart_2": f64[]
  "Freeze Graphs_2": bool
  "Ventilation_8": bool
  "Date_2": string = "27-08-2020"
  "Time_2": string = "11:50:55"
  "Machine Hour_2": string
  "Patient Hour_2": string = "1:30:88"
  "Pressure Settings_2": enum{"RELATIVE", "ABSOLUTE"} = "RELATIVE"
  "Reset Patient Hour_2": bool
  "Ventilation_9": bool
  "Maintanance_2": bool
  "Calibration_2": bool
  "Ventilation Report_2": i32 = -1
  "Pediatric Circuite_2": enum{"YES", "NO"} = "YES"
  "Apnea Alarm_2": enum{"YES", "NO"} = "YES"
  "Ventilation_10": bool
  "Patient Pressure_2": cluster{"Slope(M)": f64, "Intercept(c)": f64} = {"Slope(M)"=5, "Intercept(c)"=5}
  "Insp Valve Pressure_2": cluster{"Slope(M)": f64, "Intercept(c)": f64} = {"Slope(M)"=5, "Intercept(c)"=5}
  "Insp Flow_2": cluster{"Slope(M)": f64, "Intercept(c)": f64} = {"Slope(M)"=5, "Intercept(c)"=5}
  "Exhalation flow_2": cluster{"Slope(M)": f64, "Intercept(c)": f64} = {"Slope(M)"=5, "Intercept(c)"=5}
  "Fio2_2": cluster{"Slope(M)": f64, "Intercept(c)": f64} = {"Slope(M)"=5, "Intercept(c)"=5}
  "Ventilation_11": bool
  "Fault Check list_2": i32 = -1
  "Software Version No_2": string = "3455X776"
  "Serial No_2": string = "3465546"
  "Turbine Speed Test_2": string
  "Rate_7": f64 = 13
  "UP_2": bool
  "Down_2": bool
  "Max_2": bool
  "Altitude Settinds_2": enum{"YES", "NO"} = "YES"
  "Rate_8": f64 = 13
  "Ventilation_12": bool
  "Alarm Log List_2": i32 = -1
  "Alarm_4": bool
  "Export report": bool
  "timeout": i32 = 10000
panel indicators:
  "Tab": i32
  "VtI (mL)": f64
  "VtE (mL)": f64
  "M Vol (L)": f64
  "Rate (bpm)": f64
  "I": f64
  "FiO2 (%)": f64
  "E": f64
  "Active Mode": string
  "Pressure": string
  "Last Alarm": string
  "PressureChart": f64[]
  "FlowChart": f64[]
  "Post value": cluster{"Acknowledged": bool}
  "body": string
  "PIP (cmH2O)_2": f64
  "PIP (cmH2O)_5": f64
  "PIP (cmH2O)_8": f64
  "PIP (cmH2O)_11": f64
  "Alarm Log List": i32
  "PIP": f64
  "PEEP": f64
  "Current": f64
  "PIP(CMofH2O)": f64
  "Ventilation time": string
  "Date": string
  "Ventilation Report": string
  "Vte": string
  "Vti": string
  "Spontaneous Breath": string
  "Paw": string
  "Apnea Ti": string
  "Rate_3": string
  "Machine Hour": string
  "Patient Hour": string
  "Status_2": string
  "product": f64
  "Get body": string
  "loop iteration": i32
  "JSON string to Post": string
  "URL_2": string
  "headers": string
  "Current_2": f64
  "Active Mode_2": string
  "Tab_2": i32
types:
  T1 = cluster{"M Vol (L)": f64, "VtI (mL)": f64, "Rate (bpm)": f64, "E": f64, "cmH2O": f64, "VtE (mL)": f64, "Pressure": f64[], "Flow": f64[], "Volume": f64[]}
  T2 = cluster{"Rate": f64, "Insp. Time": f64, "Pi (cmH2O)": f64, "PEEP (cmH2O)": f64, "Vt Target": f64}
uses:
  NI::HTTP::GET.gvi
  NI::HTTP::POST Buffer.gvi
  WebApp::Keypad.gvi
diagram:
  Build Array(reference to "Alarm", reference to "Waveform", reference to "Report", reference to "Edit and Apply", reference to "EDIT MODE") -> w1
  Build Array(reference to "Vt Target", reference to "Pi (cmH2O)", reference to "Insp. Time", reference to "Rise Time", reference to "Rate", reference to "I Sense", reference to "PEEP (cmH2O)", reference to "Rate_2") -> w2
  Build Array(reference to "Start", reference to "Edit and Apply") -> w3
  for {
    w4 = each element of w3
    Property Node(instance in=w4, "Value"=FALSE) -> (error out=w6)
    append w6 to w5
  }
  Property Node(instance in=reference to "Tab", "Value"=0) -> (instance out=w7)
  s1 = w7  # shift register
  s2 = uninitialised  # shift register
  while (iteration -> i1) (after w5) (after 0) {
    w8 = $URL
    event (timeout = 200) {
      on "Timeout" {
        disable {
          frame Enabled {
            w11 = default
          }
          frame Disabled {
            Property Node(instance in=cluster{"HMI": u16} {all zero or empty}, "HMI"=$"EDIT MODE") -> (instance out=w12)
            Flatten To Json(anything=w12) -> (JSON string=w13, error out=w11)
          }
        }
        Concatenate Strings(w8, "General") -> w14
        call "GET.gvi"(timeout=$timeout, url=w14, error in=w11) -> (headers=w15, body=w16, error out=w17)
        $headers <- w15
        Unflatten From Json(JSON string=w16, error in (no error)=w17, type and defaults=T1 {all zero or empty}) -> (value=w18)
        Property Node(instance in=w18) -> ("M Vol (L)"=w19, "VtI (mL)"=w20, "Rate (bpm)"=w21, "E"=w22, "cmH2O"=w23, "VtE (mL)"=w24, "Pressure"=w25, "Flow"=w26, "Volume"=w27)
        $"M Vol (L)" <- w19
        $"VtI (mL)" <- w20
        $"Rate (bpm)" <- w21
        $E <- w22
        $URL_2 <- w14
        $"Get body" <- w16
        case ($"Freeze Graphs") {
          frame True { }
          frame False {
            $PressureChart <- w25
            $FlowChart <- w26
          }
        }
        $"VtE (mL)" <- w24
        Random Number() -> (number (0 to 1)=w28)
        Multiply(w28, 10) -> w29
        $product <- w29
        w9 = s1
        w10 = s2
      }
      on "Insp. Time" Value changed; "PEEP (cmH2O)" Value changed; "Pi (cmH2O)" Value changed; "Rate" Value changed; "Vt Target" Value changed {
        Concatenate Strings(w8, "UpdatePara") -> w30
        Property Node(instance in=T2 {all zero or empty}, "Rate"=$Rate, "Insp. Time"=$"Insp. Time", "Pi (cmH2O)"=$"Pi (cmH2O)", "PEEP (cmH2O)"=$"PEEP (cmH2O)", "Vt Target"=$"Vt Target") -> (instance out=w31)
        Flatten To Json(anything=w31) -> (JSON string=w32, error out=w33)
        call "POST Buffer.gvi"(url=w30, buffer=w32, error in=w33, timeout=100) -> (body=w34, error out=w35)
        $body <- w34
        Unflatten From Json(JSON string=w34, error in (no error)=w35, type and defaults=cluster{"Acknowledged": bool} {all zero or empty}) -> (value=w36)
        $"Post value" <- w36
        $"JSON string to Post" <- w32
        w9 = s1
        w10 = default
      }
      on "Start" Value changed {
        Event Data() -> ("Control Reference"=w37, "New Value"=w10)
        case (w10) {
          frame False {
            for {
              w39 = each element of w2
              Property Node(instance in=w39, "Disabled"=FALSE)
            }
            Build Array("Active ventilation") -> w40
            Property Node(instance in=w37, "Text"=w40)
            Property Node(instance in=reference to "EDIT MODE", "Disabled"=FALSE)
            for {
              w41 = each element of w1
              w42 = each element of [FALSE, TRUE, FALSE, TRUE]
              Property Node(instance in=w41, "Disabled"=w42)
            }
            w38 = "-"
          }
          frame True {
            for {
              w43 = each element of w2
              Property Node(instance in=w43, "Disabled"=TRUE)
            }
            Property Node(instance in=reference to "EDIT MODE") -> ("Value"=w44)
            Format Into String(w44) -> w38
            Property Node(instance in=reference to "EDIT MODE", "Disabled"=TRUE)
            Build Array("Go to Stand by") -> w45
            Property Node(instance in=w37, "Text"=w45)
            for {
              w46 = each element of w1
              w47 = each element of [FALSE, FALSE, FALSE, FALSE]
              Property Node(instance in=w46, "Disabled"=w47)
            }
          }
        }
        $"Active Mode" <- w38
        w9 = s1
      }
      on "Alarm" Value changed; "Alarm Log" Value changed; "Back to Alarm" Value changed; "Back to Ventilation_2" Value changed; "Back to Ventilation_3" Value changed; "Back to Ventilation_4" Value changed; "Report" Value changed; "Waveform" Value changed {
        Event Data() -> ("Control Reference"=w48)
        Property Node(instance in=w48) -> ("Text"=w49)
        Array Index(array=w49) -> (out0[0]=w50)
        case (w50) {
          frame "Report" {
            w51 = 3
          }
          frame "Waveform" {
            w51 = 2
          }
          frame "Alarm" {
            w51 = 1
          }
          frame "Back to Ventilation_2", "Back to Ventilation_3", "Back to Ventilation_4", Default {
            w51 = 0
          }
          frame "Alarm Log" {
            w51 = 4
          }
          frame "Back to Alarm" {
            w51 = 1
          }
        }
        Property Node(instance in=s1, "Value"=w51) -> (instance out=w9)
        w10 = default
      }
      on "EDIT MODE" Value changed {
        case (s2) {
          frame True {
            Property Node(instance in=reference to "Edit and Apply", "Disabled"=FALSE)
          }
          frame False {
            Property Node(instance in=reference to "Edit and Apply", "Disabled"=TRUE)
          }
        }
        Event Data() -> ("New Value"=w52)
        case (w52) {
          frame "V A/C", Default {
            w54 = ["Vt", "PIP", "Insp Time", "Ramp Pattern", "Rate", "I Sense", "NA", "NA"]
            w53 = w54
          }
          frame "P A/C" {
            w55 = ["Pi (cmH2O)", "PEEP", "Rise time", "Insp time", "Rate", "I Sense", "NA", "NA"]
            w53 = w55
          }
          frame "PSV" {
            w56 = ["P support", "PEEP", "Rise time", "Min I time", "Max I time", "I Sense", "E Sense", "Apnea time"]
            w53 = w56
          }
          frame "VSIMV" {
            w57 = ["Vt", "PEEP", "Rise time", "P support", "Rate", "I Sense", "E Sense", "Insp time"]
            w53 = w57
          }
          frame "PSIMV" {
            w58 = ["Pi", "PEEP", "Rise time", "P support", "Rate", "I Sense", "E Sense", "Insp time"]
            w53 = w58
          }
        }
        for {
          w59 = each element of w53
          w60 = each element of w2
          Property Node(instance in=w60) -> ("Label"=w61)
          Property Node(instance in=w61, "Text"=w59)
        }
        w9 = s1
        w10 = s2
      }
      on "Edit and Apply" Value changed {
        Event Data() -> ("Control Reference"=w62, "New Value"=w63)
        case (w63) {
          frame True {
            Build Array("Apply") -> w64
            Property Node(instance in=w62, "Text"=w64)
            for {
              w65 = each element of w2
              Property Node(instance in=w65, "Disabled"=FALSE)
            }
            Property Node(instance in=reference to "EDIT MODE", "Disabled"=FALSE)
          }
          frame False {
            Build Array("Edit") -> w66
            Property Node(instance in=w62, "Text"=w66)
            for {
              w67 = each element of w2
              Property Node(instance in=w67, "Disabled"=TRUE)
            }
            Property Node(instance in=reference to "EDIT MODE", "Disabled"=TRUE)
            Property Node(instance in=reference to "EDIT MODE") -> ("Value"=w68)
            Format Into String(w68) -> w69
            Property Node(instance in=reference to "Active Mode", "Value"=w69)
          }
        }
        w9 = s1
        w10 = s2
      }
    }
    $"loop iteration" <- i1
    next s1 = w9
    next s2 = w10
    stop if FALSE
  }
  for {
    w70 = each element of w1
    w71 = each element of [FALSE, TRUE, FALSE, TRUE, FALSE]
    Property Node(instance in=w70, "Disabled"=w71)
  }
  $Tab <- 0
  call "Keypad.gvi"()
